vi "எண்முறை.gviweb"   [G Web Development Software 22.3.0]
panel controls:
  "Next": string = "தொடர்முறை.html"
  "Next_2": string = "தகவல்.html"
  "முன்": bool
  "அடுத்தது": bool
  "மொழி": T4 = "முத்தமிழ்"
  "அடுத்த குறள்": T9 = "நிமையம்"
panel indicators:
  "கிழமை(7)": T1
  "௳(௩௬௬)": u16
  "ஆண்டு": u32
  "திங்கள்(12)": T2
  "பருவம்(௬)": T3
  "நாள்(32)": u8
  "குறள் எண்": u16
  "திருக்குறள்": string
  "பால்": enum{"அறம்", "பொருள்", "இன்பம்"}
  "அதிகாரம்": T5
  "இயல்": T6
  "பாகை": T7
  "நாழிகை(௬௰)": cluster{"சிறுபொழுது (6)": T8, "நாடி(௰)": u8}
  "துளி(௬௰)": cluster{"கணம்(6)": u8, "விநாடி(௰)": u8}
  "தற்பாரை (௰)": cluster{"சணிகம்(2)": u8, "நொடி(2)": u8}
  "பொழுது (2)": enum{"இரவு", "பகல்"}
  "தற்பாரை(௬௰)": cluster{"அணு(6)": u8, "தற்பாரை(௰)": f64}
types:
  T1 = enum{"ஞாயிறு", "திங்கள்", "செவ்வாய்", "அறிவன்", "வியாழன்", "வெள்ளி", "காரி"}
  T2 = enum{"ஆவணி", "புரட்டாசி", "ஐப்பசி", "கார்த்திகை", "மார்கழி", "தை", "மாசி", "பங்குனி", "சித்திரை", "வைகாசி", "ஆனி", "ஆடி"}
  T3 = enum{"கார்", "கூதிர்", "முன்பனி", "பின்பனி ", "இளவேனில்", "முதுவேனில்"}
  T4 = enum{"முத்தமிழ்", "ஆங்கிலம் (English)", "தெலுங்கு (తెలుగు)", "மலையாளம் (മലയാളം)", "கன்னடம் (ಕನ್ನಡ)", "சீனம் (汉语)", "மலாய் (Melayu)", "கொரிய (한국어)", "உருசிய (Русский)", "அரபு (العَرَبِيَّة)", "பிரெஞ்சு (Français)", "செர்மன் (Deutsch)", "சுவீடிய (Svenska)", "இலத்தீன் (Latīna)", "போலிய (Polski)"}
  T5 = enum{"கடவுள் வாழ்த்து", "வான்சிறப்பு", "நீத்தார் பெருமை", "அறன்வலியுறுத்தல்", "இல்வாழ்க்கை", "வாழ்க்கைத் துணைநலம்", "மக்கட்பேறு", "அன்புடைமை", "விருந்தோம்பல்", "இனியவைகூறல்", "செய்ந்நன்றி அறிதல்", "நடுவு நிலைமை", "அடக்கமுடைமை", "ஒழுக்கமுடைமை", "பிறனில் விழையாமை", "பொறையுடைமை", "அழுக்காறாமை", "வெஃகாமை", "புறங்கூறாமை", "பயனில சொல்லாமை", "தீவினையச்சம்", "ஒப்புரவறிதல்", "ஈகை", "புகழ்", "அருளுடைமை", "புலான்மறுத்தல்", "தவம்", "கூடாவொழுக்கம்", "கள்ளாமை", "வாய்மை", "வெகுளாமை", "இன்னாசெய்யாமை", "கொல்லாமை", "நிலையாமை", "துறவு", "மெய்யுணர்தல்", "அவாவறுத்தல்", "ஊழ்", "இறைமாட்சி", "கல்வி", "கல்லாமை", "கேள்வி", "அறிவுடைமை", "குற்றங்கடிதல்", "பெரியாரைத் துணைக்கோடல்", "சிற்றினஞ்சேராமை", "தெரிந்துசெயல்வகை", "வலியறிதல்", "காலமறிதல்", "இடனறிதல்", "தெரிந்துதெளிதல்", "தெரிந்துவினையாடல்", "சுற்றந்தழால்", "பொச்சாவாமை", "செங்கோன்மை", "கொடுங்கோன்மை", "வெருவந்தசெய்யாமை", "கண்ணோட்டம்", "ஒற்றாடல்", "ஊக்கமுடைமை"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}
  T6 = enum{"பாயிரவியல்", "இல்லறவியல்", "துறவறவியல்", "ஊழியல் ", "அரசியல்", "அமைச்சியல்", "அரணியல்", "கூழியல்", "படையில்", "நட்பியல்", "குடியியல்", "களவியல்", "கற்பியல்"}
  T7 = cluster{"நாழிகை(௬௰)": u8, "துளி(௬௰)": u8, "தற்பாரை(௬௰)": f64}
  T8 = enum{"மாலை", "இடையாமம்", "வைகறை", "காலை", "நண்பகல்", "எற்பாடு"}
  T9 = enum{"துளி", "நிமையம்", "கணம்", "மணி", "நாழிகை", "சிறுபொழுது", "நாள்"}
uses:
  நேரம்::குழலிசை::குறள்தொடக்கம்.gviweb
  நேரம்::குழலிசை::நேரம் மாற்று.gviweb
  நேரம்::குழலிசை::குறள்படி.gviweb
diagram:
  call "குறள்தொடக்கம்.gviweb"(கணம்?=FALSE) -> (தொடக்கம்=w1)
  s1 = w1  # shift register
  s2 = TRUE  # shift register
  s3 = uninitialised  # shift register
  s4 = uninitialised  # shift register
  s5 = uninitialised  # shift register
  while {
    call "நேரம் மாற்று.gviweb"(அடுத்த குறள்=$"அடுத்த குறள்") -> (காலநேரம்=w2, அடுத்தது?=w3)
    Property Node(instance in=w2) -> ("தொல்காப்பியம்:பருவம் (6)"=w4, "திருவள்ளுவர்:௵"=w5, "திருவள்ளுவர்:௳(366)"=w6, "தொல்காப்பியம்:௴(12)"=w7, "தொல்காப்பியம்:௳(32)"=w8, "தெறிப்பு:கிழமை(7)"=w9, "பாகை"=w10, "நாழிகை"=w11, "துளி"=w12, "தற்பாரை"=w13, "தற்பாரை(10)"=w14)
    $"பருவம்(௬)" <- w4
    $"ஆண்டு" <- w5
    $"௳(௩௬௬)" <- w6
    $"திங்கள்(12)" <- w7
    $"நாள்(32)" <- w8
    $"கிழமை(7)" <- w9
    case (s2) {
      frame False, Default {
        w15 = s1
        w16 = s3
        w17 = s4
        w18 = s5
      }
      frame True {
        call "குறள்படி.gviweb"(அடைவு=s1) -> (குறள் எண்=w15, திருக்குறள்=w17, பொருள்=w16, தகவல்=w18)
      }
    }
    Is First Call() -> w19
    Logical Or(w3, w19) -> w20
    case (w20) {
      frame False {
        Logical Or($"அடுத்தது", $"முன்") -> w21
        case ($"முன்") {
          frame False, Default {
            w22 = w15
          }
          frame True {
            Subtract(x=w15, y=2) -> w22
          }
        }
        $"குறள் எண்" <- w15
        Array Index(array=w16) -> (out0[$"மொழி"]=w26)
        Concatenate Strings(w17, "\r\n", w26) -> w27
        $"திருக்குறள்" <- w27
        Property Node(instance in=w18) -> ("பால்"=w28, "இயல்"=w29, "அதிகாரம்"=w30)
        $"பால்" <- w28
        $"இயல்" <- w29
        $"அதிகாரம்" <- w30
        w23 = w16
        w24 = w17
        w25 = w18
      }
      frame True {
        w21 = w20
        w22 = w15
        w23 = w16
        w24 = w17
        w25 = w18
      }
    }
    $"பாகை" <- w10
    $"நாழிகை(௬௰)" <- w11
    $"துளி(௬௰)" <- w12
    $"தற்பாரை(௬௰)" <- w13
    $"தற்பாரை (௰)" <- w14
    Wait(time to wait=400)
    next s1 = w22
    next s2 = w21
    next s3 = w23
    next s4 = w24
    next s5 = w25
    stop if FALSE
  }
