vi "குறளிசை.gviweb"   [G Web Development Software 22.3.0]
inputs:
  "தொடக்கம்": u16
outputs:
  "Kural": string
  "output": string
  "error out": error
uses:
  NI::HTTP::GET.gvi
  குழலிசை::குழலிசை.jsli::குழல்
diagram:
  case ($"தொடக்கம்") {
    frame 1..380, Default {
      w1 = "அறம்"
    }
    frame 381..1080 {
      w1 = "பொருள்"
    }
    frame 1081..1330 {
      w1 = "இன்பம்"
    }
  }
  Format Into String(formatString="%s/திருக்குறள்-%04d.", initString="குறளிசை/", w1, $"தொடக்கம்") -> (outString=w2, errOut=w3)
  Concatenate Strings(w2, "mp3") -> w4
  Concatenate Strings(w2, "html") -> w5
  call "GET.gvi"(url=w5, error in=w3) -> (body=w6, error out=w7)
  call "குழல்"(X=w4, error in=w7) -> (Z=w8, error out=w9)
  $output <- w8
  $"error out" <- w9
  $Kural <- w6
