vi "குறள்தொடக்கம்.gviweb"   [G Web Development Software 21.0.0]
inputs:
  "கணம்?": bool
outputs:
  "தொடக்கம்": u16
uses:
  நேரம்::குழலிசை::நேரம் மாற்று.gviweb
diagram:
  call "நேரம் மாற்று.gviweb"() -> (காலநேரம்=w1)
  Property Node(instance in=w1) -> ("திருவள்ளுவர்:௵"=w2, "திருவள்ளுவர்:௳(366)"=w3, "தெறிப்பு:மணி(24)"=w4, "தெறிப்பு:நிமையம்(60)"=w5)
  case ($"கணம்?") {
    frame False, Default {
      case (w4) {
        frame Default {
          w7 = w4
        }
        frame ..7 {
          Add(24, w4) -> w7
        }
      }
      Subtract(x=w7, y=8) -> w8
      Multiply(w8, 60) -> w9
      Add(w9, w5) -> w6
    }
    frame True {
      Quotient And Remainder(x=w5, y=4) -> (floor(x/y)=w10)
      Multiply(w4, 15) -> w11
      Quotient And Remainder(x=w3, y=133) -> (x-y*floor(x/y)=w12)
      Multiply(36, w12) -> w13
      Quotient And Remainder(x=w2, y=133) -> (x-y*floor(x/y)=w14)
      Multiply(115, w14) -> w15
      Quotient And Remainder(x=w15, y=133) -> (x-y*floor(x/y)=w16)
      Add(w16, w13) -> w17
      Multiply(w17, 10) -> w18
      Add(w18, w11, w10) -> w6
    }
  }
  Quotient And Remainder(x=w6, y=1330) -> (x-y*floor(x/y)=w19)
  $"தொடக்கம்" <- w19
